# Grasshopper definition TestConnection.gh (Grasshopper 1.0.7)
# Copyright: 2021
# plug-ins: GrasshopperRadianceLinuxConnector, LadybugGrasshopper

# ----
# Connect
toggle = BooleanToggle(True)
connect_ssh = ConnectSSH(User="mss", Ip="127.0.0.1", Password="_prompt", _port=22, Connect=toggle)  # -> Status, Run
panel = Panel(connect_ssh.Status)

# ----
# Test connection
testconnection = TestConnection()  # -> Status, Errors
panel_2 = Panel(testconnection.Status)
panel_3 = Panel(testconnection.Errors)

win = Geometry([<brep referenced from the Rhino model> x3])
floor = Geometry([<brep referenced from the Rhino model> x2])
walls = Geometry([<brep referenced from the Rhino model> x2])
panel_4 = Panel("""Floors
Walls""")

panel_5 = Panel("""echo $PATH
genbox""")
falsestart = LBFalseStartToggle(False)
execute_ssh = ExecuteSSH(SSHCommands=panel_5, Run=falsestart)  # -> Stdout, Stderr, Log, Success
panel_6 = Panel(execute_ssh.Stderr)
panel_7 = Panel(execute_ssh.Stdout)

# ----
# Check if ximage and other x-commands work.
# Must have Xlaunch running on windows with disabled access control
panel_8 = Panel("""export "DISPLAY=$(ip route list default | awk '{print $3}'):0"
export "LIBGL_ALWAYS_INDIRECT = 1"
xclock&""")
falsestart_2 = LBFalseStartToggle(False)
execute_ssh_2 = ExecuteSSH(SSHCommands=panel_8, Run=falsestart_2)  # -> Stout, Errors, Errors_2, Success

falsestart_3 = LBFalseStartToggle(False)
execute_ssh_3 = ExecuteSSH(SSHCommands=["cat ~/.bashrc", "dwd | tee ~/simulation/log.txt"], Run=falsestart_3)  # -> Stdout, Stderr, Log, Success
panel_9 = Panel(execute_ssh_3.Stdout)
panel_10 = Panel(execute_ssh_3.Log)
panel_11 = Panel(execute_ssh_3.Stderr)

# ----
# test xview commands (xclock)
panel_12 = Panel("""export "DISPLAY=$(ip route list default | awk '{print $3}'):0"
export "LIBGL_ALWAYS_INDIRECT = 1"
xclock&""")
falsestart_4 = LBFalseStartToggle(False)
execute_ssh_4 = ExecuteSSH(SSHCommands=panel_12, Run=falsestart_4)  # -> Stdout, Stderr, Log, Success

mesh = Mesh(win)
mesh_2 = Mesh(floor)
mesh_3 = Mesh(walls)

# ----
# Run a SSH Command
panel_13 = Panel("""cd ~/simulation
pwd
ls
echo "lol" > ~/simulation/points.pts""")
falsestart_5 = LBFalseStartToggle(False)
execute_ssh_5 = ExecuteSSH(SSHCommands=panel_13, Run=falsestart_5)  # -> Stdout, Stderr, Log, Success
panel_14 = Panel(execute_ssh_5.Stdout)

graft = GraftTree(Tree="WindowMat", IncludeEmptyLists=True, IncludeNullItems=True)
entwine = Entwine(Branch00=mesh_2, Branch01=mesh_3, FlattenInputs=True)
falsestart_6 = LBFalseStartToggle(True)

# ----
# Grid
# grid points
rectangle = Rectangle(Plane=PlaneXY(-194.7254335, -90.60693642, 0), XSize=Domain(-5, 500), YSize=Domain(-3, 300), Radius=0)  # -> Rectangle, Length
sdivide = DivideSurface(Surface=rectangle.Rectangle, UCount=10, VCount=10)  # -> Points, Normals, Parameters
panel_15 = Panel(sdivide.Parameters)
points2pts = PointsToPts(Points=flatten(sdivide.Points), Vectors=Vector(0, 0, 1), Name="points", Run=invert(falsestart_6))  # -> PtsFile, Run
points = Text(points2pts.PtsFile)

graft_2 = GraftTree(Tree=panel_4, IncludeEmptyLists=True, IncludeNullItems=True)
concat = Concatenate(FragmentA=graft_2, FragmentB="_mat")
item = ListItem(List=entwine, Index=0, Wrap=True)
panel_16 = Panel(execute_ssh_5.Stderr)
long = LongestList(ListA=item, ListB="blackMaterial", PaddingMode=2)  # -> ListA, ListB

# ----
# 5 phase bash script from andy mcneil
panel_17 = Panel("""#!/bin/bash

procs=4

### First let me download and unpacking Axel\'s files for rtcontrib lesson

printf "\nDownloading Axels rtcontrib lesson files...\n"
curl -O http://www.jaloxa.eu/resources/radiance/documentation/docs/rtcontrib_lesson.tgz
tar -xf rtcontrib_lesson.tgz
mv rtcontrib_lesson 5p_tutorial_examples

cd 5p_tutorial_examples

mkdir bsdf hourlypics hourlypics_dir hourlypics_ds hourlyresult \
	matrices octs viewpics viewpics_dir viewpics_ds
	
### Let me download the weather data file for you
printf "\nDownloading weather data...\n"
curl -O http://apps1.eere.energy.gov/buildings/energyplus/weatherdata/4_north_and_central_america_wmo_region_4/1_usa/USA_CA_Oakland.Intl.AP.724930_TMY3.zip
tar -xf USA_CA_Oakland.Intl.AP.724930_TMY3.zip
rm USA_CA_Oakland.Intl.AP.724930_TMY3.ddy 
rm USA_CA_Oakland.Intl.AP.724930_TMY3.stat
rm USA_CA_Oakland.Intl.AP.724930_TMY3.zip 
mv USA_CA_Oakland.Intl.AP.724930_TMY3.epw skies/.

# grabbing reinsrc.cal from CVS
printf "\nDownloading reinsrc.cal...\n"
curl -O http://radiance-online.org/cgi-bin/viewcvs.cgi/ray/src/cal/cal/reinsrc.cal

### Section 6.1 - Model adjustments for five-phase simulation
printf "\nMaking model adjustments...\n"
cat <<EOF > objects/testroom_Swall.rad
!genbox wall_mat wall_s_bottom 4 .3 1 |xform -t 0 -.3 0
!genbox wall_mat wall_s_top 4 .3 .5 |xform -t 0 -.3 2
!genbox wall_mat wall_s_west .5 .3 1 |xform -t 0 -.3 1
!genbox wall_mat wall_s_west .5 .3 1 |xform -t 3.5 -.3 1
EOF

cat <<EOF > objects/testroom.rad
!genbox floor_mat floor 4.6 6.6 .3 |xform -t -.3 -.3 -.3
!genbox ceiling_mat ceiling 4.6 6.6 .3 |xform -t -.3 -.3 2.5

!genbox wall_mat wall_w .3 6.6 2.5 |xform -t -.3 -.3 0
!genbox wall_mat wall_e .3 6.6 2.5 |xform -t 4 -.3 0
!genbox wall_mat wall_n 4 .3 2.5 |xform -t 0 6 0
EOF

cat <<EOF > objects/glazing.rad
void glass glazing
0
0
3 0.73 0.73 0.73

glazing polygon glass
0
0
12    0.5  -0.25   1
        0.5  -0.25   2
        3.5  -0.25   2
        3.5  -0.25   1
EOF

cat <<EOF > objects/venetianblind.rad
void plastic blindslat
0
0
5 .65 .65 .65 .01 0 

!genblinds blindslat blinds .05 3 1 25 0 +r .15 | xform -rz -90 -t 0.5 -.15 1 
EOF

cat <<EOF > objects/viewmtxsurf.rad
void glow viewsurf
0
0
4 1 1 1 0

viewsurf polygon inside
0
0
12    0.5   0   1
        0.5   0   2
        3.5   0   2
        3.5   0   1
EOF

cat <<EOF > objects/daymtxsurf.rad
void plastic daymtxsurf
0
0
5 0 0 0 0 0

daymtxsurf polygon outside
0
0
12    0.5   -0.3   1
        0.5   -0.3   2
        3.5   -0.3   2
        3.5   -0.3  1
EOF

cat <<EOF > objects/glazing_bsdf.rad
void BSDF BSDFproxy
6 0.30 bsdf/fullwindow_t45.xml 0 0 1 .
0
0

BSDFproxy polygon inside
0
0
12    0.5   0   1
        0.5   0   2
        3.5   0   2
        3.5   0   1
EOF

cat <<EOF >> materials/testroom.mat
void plastic black
0
0
5 0 0 0 0 0
EOF


### Section 6.2 - Creating BSDFs
xform -rz 180 -rx -90 -t 4 0 0 objects/glazing.rad objects/venetianblind.rad materials/testroom.mat \
	objects/testroom_Swall.rad > bsdf/fullwindow.rad

### I am going to save you the trouble of generating the High-Res BSDF
#genBSDF -n $procs +f +b -geom meter -dim 0.5 3.5 1 2 -.3 0 -t4 5 \
#	bsdf/fullwindow.rad > bsdf/fullwindow_t45.xml
printf "\nDownloading tensor tree BSDF...\n"
curl -o bsdf/fullwindow_t45.xml http://www.radiance-online.org/learning/tutorials/fivephasetutorialfiles/fullwindow_t45.xml

### I will also save you the trouble with the low-res BSDF
#bsdf2klems bsdf/fullwindow_t45.xml > bsdf/fullwindow_klems.xml
#genBSDF -n $procs +f +b -geom meter -dim 0.5 3.5 1 2 -.3 0 \
#	bsdf/fullwindow.rad > bsdf/fullwindow_klems.xml
printf "\nDownloading klems BSDF...\n"
curl -o bsdf/fullwindow.xml http://www.radiance-online.org/learning/tutorials/fivephasetutorialfiles/fullwindow.xml


### Section 6.3 - View matrix (V)
printf "\nDoing 5-phase simulation for sensor points...\n"
oconv materials/testroom.mat objects/daymtxsurf.rad objects/ground.rad objects/testroom.rad \
	objects/testroom_Swall.rad objects/viewmtxsurf.rad skies/sky_white.rad \
	objects/viewmtxsurf.rad objects/daymtxsurf.rad > octs/model_3ph.oct
printf "\nView Matrix\n"
time rcontrib < data/photocells.pts -n $procs -f klems_int.cal -b kbinS -bn Nkbins -m viewsurf \
	-I+ -ab 10 -ad 65536 -lw 1.52e-5 octs/model_3ph.oct > matrices/viewmatrix.vmx


### Section 6.4 - Direct view matrix (Vd)
printf "\nDirect View Matrix\n"
time rcontrib < data/photocells.pts -n $procs -f klems_int.cal -b kbinS -bn Nkbins -m viewsurf \
	-I+ -ab 1 -ad 65536 -lw 1.52e-5 octs/model_3ph.oct > matrices/viewmatrix_direct.vmx

### Section 6.5 - Daylight matrix (D)
printf "\nDaylight Matrix\n"
time genklemsamp -c 1000 -vd 0 -1 0 objects/daymtxsurf.rad | \
	rcontrib -n $procs -c 1000 -ab 2 -ad 1024 -e MF:1 -f reinhart.cal -b rbin -bn Nrbins \
		-m sky_glow octs/model_3ph.oct > matrices/daylightmatrix.dmx

### Section 6.6 - Direct daylight matrix (Dd)
printf "\nDirect Daylight Matrix\n"
xform -m black objects/testroom_Swall.rad objects/testroom.rad objects/ground.rad \
	objects/venetianblind.rad | oconv materials/testroom.mat - objects/viewmtxsurf.rad \
	objects/daymtxsurf.rad skies/sky_white.rad > octs/model_allblack.oct

time genklemsamp -c 1000 -vd 0 -1 0 objects/daymtxsurf.rad | \
	rcontrib -n $procs -c 1000 -ab 0 -e MF:1 -f reinhart.cal -b rbin -bn Nrbins \
		-m sky_glow octs/model_allblack.oct > matrices/daylightmatrix_direct.dmx

### Section 6.7 - Direct sun coefficient matrix (Cds)
printf "\nDirect Sun Coefficient Matrix\n"
echo void light solar 0 0 3 1e6 1e6 1e6 > skies/suns.rad
cnt 5185  |  rcalc -e MF:6 -f reinsrc.cal -e Rbin=recno \
	-o 'solar source sun 0 0 4 ${ Dx } ${ Dy } ${ Dz } 0.533' >> skies/suns.rad

xform -m black objects/testroom_Swall.rad objects/testroom.rad objects/ground.rad \
	| oconv materials/testroom.mat - objects/glazing.rad objects/venetianblind.rad \
		objects/glazing_bsdf.rad skies/suns.rad > octs/model_suns.oct

time rcontrib < data/photocells.pts -n $procs -I -ab 1 -ad 65536 -lw 1.52e-5 -dc 1 -dt 0 -dj 0 -st 1 -ss 0 -faf  \
	-e MF:6 -f reinhart.cal -b rbin -bn Nrbins -m solar \
	octs/model_suns.oct > matrices/directsun.dsmx

### Section 6.8 - Putting it all together
printf "\nCombining it all\n"
epw2wea skies/USA_CA_Oakland.Intl.AP.724930_TMY3.epw skies/OakLand.wea
gendaymtx -of skies/OakLand.wea > matrices/OakLand.smx
gendaymtx -of -d skies/OakLand.wea > matrices/OakLand_direct.smx
gendaymtx -5 -d -m 6 -of skies/OakLand.wea > matrices/OakLand_direct_m6.smx

time dctimestep -n 8760 -if matrices/viewmatrix.vmx bsdf/fullwindow.xml  \
	matrices/daylightmatrix.dmx matrices/OakLand.smx | \
	rcollate -h -oc 1 > i_3ph.txt

time dctimestep -n 8760 -if  matrices/viewmatrix_direct.vmx bsdf/fullwindow.xml  \
	matrices/daylightmatrix_direct.dmx matrices/OakLand_direct.smx | \
	rcollate -h -oc 1 > i_ds3ph.txt

time dctimestep -n 8760 -if matrices/directsun.dsmx matrices/OakLand_direct_m6.smx | \
	rcollate -h -oc 1 > i_ds5ph.txt

rlam i_3ph.txt i_ds3ph.txt i_ds5ph.txt | \
	rcalc -e 'r=$1-$4+$7;g=$2-$5+$8;b=$3-$6+$9' \
	-e '$1=179*(.265*r+.670*g+.065*b)' | \
	rcollate -h -fa1 -ic 8760 -t > illum.txt

printf "\nAll done with example 1!  look at illum.txt for the result.\n"


printf "\n\n\nDoing 5-phase simulation for rendering...\n"
### 7.1	View matrix (V)
printf "\nView Matrix...\n"
time vwrays -vf views/back.vf  -ff -x 500 -y 500 \
	| rcontrib `vwrays -vf views/back.vf  -x 500 -y 500 -d` -n $procs -ffc -fo -o viewpics/back_%03d.hdr \
		-f klems_int.cal -b kbinS -bn Nkbins -m viewsurf \
		-ab 10 -ad 65536 -lw 1.52e-5 octs/model_3ph.oct

### 7.2	Direct view matrix (Vd)	
printf "\nDirect View Matrix...\n"	
time vwrays -vf views/back.vf  -ff -x 500 -y 500 \
	| rcontrib `vwrays -vf views/back.vf  -x 500 -y 500 -d` -n $procs -ffc -fo -o viewpics_dir/back_%03d.hdr \
		-f klems_int.cal -b kbinS -bn Nkbins -m viewsurf \
		-ab 1 -ad 65536 -lw 1.52e-5 octs/model_3ph.oct

### 7.5	Direct sun coefficient matrix (Cds)
printf "\nDirect Coefficient Matrix...\n"
ulimit -n 9999
xform -m black objects/testroom_Swall.rad objects/testroom.rad objects/ground.rad | \
	oconv materials/testroom.mat - objects/venetianblind.rad > octs/model_nosuns.oct
time vwrays -c 4 -pj 1 -fa -vf views/back.vf -x 500 -y 500 | \
	rtrace -h- -opn -faa -ab 0 octs/model_nosuns.oct | \
	rcontrib `vwrays -vf views/back.vf -x 500 -y 500 -d` -n $procs -fac -fo -o viewpics_ds/back_%04d.hdr \
	-e MF:6 -f reinhart.cal -b rbin -bn Nrbins -m solar -c 4 -I -ab 1 -ad 100 -dt 0 -dc 1 -lw 1e-2 octs/model_suns.oct

oconv materials/testroom.mat objects/testroom_Swall.rad objects/testroom.rad \
	objects/ground.rad objects/glazing.rad objects/venetianblind.rad \
	objects/daymtxsurf.rad > octs/model_material.oct
time rpict -x 1000 -y 1000 -vf views/back.vf -ps 1 -pj 1 -av 0.31831 0.31831 0.31831 -aa 0 \
	octs/model_material.oct | pfilt -x /2 -y /2 -1 -e 1 > materialmap.hdr  

### 7.6	Putting it all together
printf "\nPutting it together...\n"
time dctimestep -n 8760 -if -o hourlypics/back_%04d.hdr viewpics/back_%03d.hdr \
	bsdf/fullwindow.xml matrices/daylightmatrix.dmx matrices/OakLand.smx 

time dctimestep -n 8760 -if -o hourlypics_dir/back_%04d.hdr viewpics_dir/back_%03d.hdr \
	bsdf/fullwindow.xml matrices/daylightmatrix_direct.dmx matrices/OakLand_direct.smx 

time dctimestep -n 8760 -if -o hourlypics_ds/back_%04d.hdr viewpics_ds/back_%04d.hdr \
	matrices/OakLand_direct_m6.smx

time for t in {1..8760} 
do ts=`printf %04d $t `
pcomb -e 'lo=li(1)-li(2)+li(3)*li(4)' -o hourlypics/back_${ts}.hdr -o hourlypics_dir/back_${ts}.hdr \
	-o hourlypics_ds/back_${ts}.hdr -o materialmap.hdr > hourlyresult/back_${ts}.hdr 
done
printf "\nAll Done with 5-phase Rendering sim\n"
pcond hourlyresult/back_0015.hdr | ximage &""")

concat_2 = Concatenate(FragmentA=graft_2, FragmentB="_black")

# ----
# window geometry
mesh2obj = MeshToObj(Mesh=mesh, Name="Windows", ModifierName="WindowMat", Run=falsestart_6)  # -> ObjFiles, MapFile, Run
obj2rad = ObjToRad(ObjFiles=mesh2obj.ObjFiles, MapFile=mesh2obj.MapFile, Run=mesh2obj.Run)  # -> Status, RadFiles, Run

# ----
# Black Geometry
mesh2obj_2 = MeshToObj(Mesh=entwine, Name=concat_2, ModifierName=long.ListB, Run=falsestart_6)  # -> ObjFiles, MapFile, Run
obj2rad_2 = ObjToRad(ObjFiles=mesh2obj_2.ObjFiles, MapFile=mesh2obj_2.MapFile, Run=mesh2obj_2.Run)  # -> Status, RadFiles, Run

# ----
# Geometry
mesh2obj_3 = MeshToObj(Mesh=entwine, Name=graft_2, ModifierName=concat, Run=falsestart_6)  # -> ObjFiles, MapFile, Run
obj2rad_3 = ObjToRad(ObjFiles=mesh2obj_3.ObjFiles, MapFile=mesh2obj_3.MapFile, Run=mesh2obj_3.Run)  # -> Status, RadFiles, Run

# ----
# export PATH=$PATH.:/usr/local/radiance/bin
# export RAYPATH=.:/usr/local/radiance/lib
# obj2rad -m /home/mss/simulation/mapping.map -f /home/mss/simulation/twoMeshes4.obj 2>&1 1>/home/mss/simulation/x.rad
# head /home/mss/simulation/x.rad
panel_18 = Panel("""export PATH=$PATH.:/usr/local/radiance/bin
export RAYPATH=.:/usr/local/radiance/lib
objline ~/simulation/twoMeshes5.rad | meta2tga -x 1048 -y 1048 | ra_t8 -r > ~/simulation/test.hdr
normtiff ~/simulation/test.hdr ~/simulation/test.tif
convert ~/simulation/test.tif ~/simulation/test.png
echo "C:\Users\mm1013\simulation\test.png"
""")

# ----
# Setup materials
panel_19 = Panel("""0.2
0.6""")
opaquegreymat = OpaqueGreyMat(Name=flatten(concat), Reflectance_0_1=panel_19, Specularity=0, Roughness=0)  # -> RadMaterials, RadMaterialList
panel_20 = Panel("""mats
target""")
entwine_2 = Entwine(Branch00=opaquegreymat.RadMaterials, Branch01="opaque_materials.rad", FlattenInputs=True)  # -> flatten(Result)
applyglobals = ApplyGlobals(Input="echo \"<mats>\" > <proj>/<target>;echo \"<proj>/<target>\"", AdditionalKeys=panel_20, AdditionalValues=entwine_2)  # -> Output, Pairs
execute_ssh_6 = ExecuteSSH(SSHCommands=applyglobals.Output, Run=obj2rad_3.Run)  # -> Stdout, Stderr, Log, Ran
opaque_mat = Text(execute_ssh_6.Stdout)
opaque_rad = Text(obj2rad_3.RadFiles)

# ----
# blackmaterials
panel_21 = Panel("0.0")
opaquegreymat_2 = OpaqueGreyMat(Name=flatten("blackMaterial"), Reflectance_0_1=panel_21, Specularity=0, Roughness=0)  # -> RadMaterials, RadMaterialList
panel_22 = Panel("echo \"<mats>\" >~/simulation/blackmats.mat;echo \"~/simulation/blackmats.mat\"")
rep = ReplaceText(Text=panel_22, Find="<mats>", Replace=opaquegreymat_2.RadMaterials, RecursiveReplace=False)
execute_ssh_7 = ExecuteSSH(SSHCommands=rep, Run=obj2rad_2.Run)  # -> Stdout, Stderr, Log, Ran
black_rad_files = Text(obj2rad_2.RadFiles)

glassmat = GlassMat(Name="Windows", Transmittance_0_1="0.8")  # -> RadMaterials, RadMaterialList

# ----
# rad files (incl mats)
# Setup glass materials
panel_23 = Panel("echo \"<mats>\" > <proj>/<target>;echo \"<proj>/<target>\"")
panel_24 = Panel("""mats
target""")
entwine_3 = Entwine(Branch00=glassmat.RadMaterials, Branch01="glass_materials.rad", FlattenInputs=True)  # -> flatten(Result)
applyglobals_2 = ApplyGlobals(Input=panel_23, AdditionalKeys=panel_24, AdditionalValues=entwine_3)  # -> Output, Pairs
execute_ssh_8 = ExecuteSSH(SSHCommands=applyglobals_2.Output, Run=obj2rad_3.Run)  # -> Stdout, Stderr, Log, Ran
window_mat = Text(execute_ssh_8.Stdout)
window_rad = Text(obj2rad.RadFiles)

# ----
# WEA file
# create WEA file
path = FilePath("C:\ladybug\NOR_OS_Alna.014870_TMYx.2004-2018\NOR_OS_Alna.014870_TMYx.2004-2018.epw")
upload = Upload(LocalFilePaths=path, Run=falsestart_6)  # -> Status, FilePaths, Run
rep_2 = ReplaceText(Text=upload.FilePaths, Find=".epw", Replace=".wea", RecursiveReplace=False)
panel_25 = Panel("""in
out""")
applyglobals_3 = ApplyGlobals(Input="epw2wea <in> <out> 1>&2;echo <out>", AdditionalKeys=panel_25, AdditionalValues=[upload.FilePaths, rep_2])  # -> Output, Pairs
execute_ssh_9 = ExecuteSSH(SSHCommands=applyglobals_3.Output, Run=upload.Run)  # -> Stdout, Stderr, Log, Success
panel_26 = Panel(execute_ssh_9.Stdout)
panel_27 = Panel(execute_ssh_9.Stderr)
wea_file = Text(execute_ssh_9.Stdout)

falsestart_7 = LBFalseStartToggle(False)
execute_ssh_10 = ExecuteSSH(SSHCommands=panel_18, Run=falsestart_7)  # -> Stdout, Stderr, Log, Success
black_mat = Text(execute_ssh_7.Stdout)
imageviewer = LBImageViewer(ImagePath_=execute_ssh_10.Stdout, _scale_=1, DisableClickable=False, SaveImgWithCoords=False, scale=1)  # -> ImagePath, Values, GIF
panel_28 = Panel(execute_ssh_10.Stderr)

# ----
# create black octree
black_rad_files_2 = Text(black_rad_files)
window_mat_2 = Text(window_mat)
black_mat_2 = Text(black_mat)
window_rad_2 = Text(window_rad)
panel_29 = Panel("oconv -f <rads> > ~/simulation/myscene_black.oct;echo ~/simulation/myscene_black.oct")
entwine_4 = Entwine(Branch00=window_mat_2, Branch01=window_rad_2, Branch02=black_mat_2, Branch03=black_rad_files_2, FlattenInputs=True)  # -> flatten(Result)
join = TextJoin(Text=flatten(entwine_4), Join=" ")
rep_3 = ReplaceText(Text=panel_29, Find="<rads>", Replace=join, RecursiveReplace=False)
execute_ssh_11 = ExecuteSSH(SSHCommands=rep_3)  # -> Stdout, Stderr, Log, Success
panel_30 = Panel(execute_ssh_11.Stdout)
octree_black = Text(panel_30)

# ----
# Create skyglow.rad
panel_31 = Panel("/home/mss/simulation/skyglow.rad")
panel_32 = Panel("""#@rfluxmtx u=+Y h=u
void glow groundglow
0
0
4 1 1 1 0

groundglow source ground
0
0
4 0 0 -1 180

#@rfluxmtx u=+Y h=r1
void glow skyglow
0
0
4 1 1 1 0

skyglow source skydome
0
0
4 0 0 1 180""")
panel_33 = Panel("""skyglow
target""")
applyglobals_4 = ApplyGlobals(Input="echo \"<skyglow>\" > <target>; echo <target>", AdditionalKeys=panel_33, AdditionalValues=[panel_32, panel_31])  # -> Output, Pairs
applyglobals_5 = ApplyGlobals(Input="head <target>", AdditionalKeys=panel_33, AdditionalValues=[panel_32, panel_31])  # -> Output, Pairs
execute_ssh_12 = ExecuteSSH(SSHCommands=applyglobals_4.Output, Run=falsestart_6)  # -> Stdout, Stderr, Log, Success
execute_ssh_13 = ExecuteSSH(SSHCommands=applyglobals_5.Output)  # -> Stdout, Stderr, Log, Success
panel_34 = Panel(execute_ssh_12.Stdout)
panel_35 = Panel(execute_ssh_13.Stdout)
skyglow = Text(panel_34)

and = GateAnd(A=execute_ssh_8.Ran, B=execute_ssh_6.Ran)

# ----
# Annual sky-matrix 145 patches
wea_file_2 = Text(wea_file)
# Skies and Skymatrices
panel_36 = Panel("gendaymtx -m 1 \"<wea>\" > <smx>;echo \"<smx>\"")
rep_4 = ReplaceText(Text=wea_file_2, Find=".wea", Replace=".smx", RecursiveReplace=False)
panel_37 = Panel("""wea
smx""")
applyglobals_6 = ApplyGlobals(Input=panel_36, AdditionalKeys=panel_37, AdditionalValues=[wea_file_2, rep_4])  # -> Output, Pairs
execute_ssh_14 = ExecuteSSH(SSHCommands=applyglobals_6.Output)  # -> Stdout, Stderr, Log, Success
panel_38 = Panel(execute_ssh_14.Stdout)

# ----
# Sun matrix with 5165 suns
wea_file_3 = Text(wea_file)
panel_39 = Panel("gendaymtx -5 0.533 -d -m 6 \"<wea>\" > <smx>;echo \"<smx>\"")
rep_5 = ReplaceText(Text=wea_file_3, Find=".wea", Replace="sunM6.smx", RecursiveReplace=False)
panel_40 = Panel("""wea
smx""")
applyglobals_7 = ApplyGlobals(Input=panel_39, AdditionalKeys=panel_40, AdditionalValues=[wea_file_3, rep_5])  # -> Output, Pairs
execute_ssh_15 = ExecuteSSH(SSHCommands=applyglobals_7.Output)  # -> Stdout, Stderr, Log, Success
panel_41 = Panel(execute_ssh_15.Stdout)

# ----
# Annual direct only daylight matrix with 145 patches
wea_file_4 = Text(wea_file)
rep_6 = ReplaceText(Text=wea_file_4, Find=".wea", Replace="d.smx", RecursiveReplace=False)
panel_42 = Panel("""wea
smx""")
applyglobals_8 = ApplyGlobals(
    Input="gendaymtx -m 1 -d \"<wea>\" > <smx>;echo \"<smx>\"",
    AdditionalKeys=panel_42,
    AdditionalValues=[wea_file_4, rep_6])  # -> Output, Pairs
execute_ssh_16 = ExecuteSSH(SSHCommands=applyglobals_8.Output)  # -> Stdout, Stderr, Log, Success
panel_43 = Panel(execute_ssh_16.Stdout)

# ----
# Generate daylight coefficients black (direct only)
panel_44 = Panel("/home/mss/simulation/dcd_illum.mtx")
panel_45 = Panel("""export PATH=$PATH.:/usr/local/radiance/bin
export RAYPATH=.:/usr/local/radiance/lib
rfluxmtx -I+ -y 100 -lw 0.0002 -ab 1 -ad 5000 -n 8 - <skyglow> -i <octree> < <points> > <target>;echo <target>""")
octree_black_2 = Text(octree_black)
skyglow_2 = Text(skyglow)
points_2 = Text(points)
panel_46 = Panel("""points
octree
skyglow
target""")
and_2 = GateAnd(PointsOk=points2pts.Run)
entwine_5 = Entwine(Branch00=points_2, Branch01=octree_black_2, Branch02=skyglow_2, Branch03=panel_44, FlattenInputs=True)  # -> flatten(Result)
applyglobals_9 = ApplyGlobals(Input=panel_45, AdditionalKeys=panel_46, AdditionalValues=entwine_5)  # -> Output, Pairs
execute_ssh_17 = ExecuteSSH(SSHCommands=applyglobals_9.Output, Run=and_2)  # -> Stdout, Stderr, Log, Success
panel_47 = Panel(execute_ssh_17.Stdout)
panel_48 = Panel(applyglobals_9.Output)

# ----
# - Results of daylight coefficients (direct from 145 sample sky)
panel_49 = Panel("/home/mss/simulation/annualR_DCD.ill")
panel_50 = Panel("""export PATH=$PATH.:/usr/local/radiance/bin
export RAYPATH=.:/usr/local/radiance/lib
dctimestep <dcillum> <skymtx> | rmtxop -fa -t -c 47.4 119.9 11.6 - > <target>;echo <target>""")
panel_51 = Panel("""dcillum
skymtx
target""")
entwine_6 = Entwine(Branch00=panel_47, Branch01=execute_ssh_16.Stdout, Branch02=panel_49, FlattenInputs=True)  # -> flatten(Result)
and_3 = GateAnd()
applyglobals_10 = ApplyGlobals(Input=panel_50, AdditionalKeys=panel_51, AdditionalValues=entwine_6)  # -> Output, Pairs
execute_ssh_18 = ExecuteSSH(SSHCommands=applyglobals_10.Output, Run=and_3)  # -> Stdout, Stderr, Log, Success
panel_52 = Panel(applyglobals_10.Output)
panel_53 = Panel(execute_ssh_18.Stdout)

m6_sky_mtx = Text(panel_41)

panel_54 = Panel("head <ill> -n 13;echo \" \";echo \"Number of lines\";wc -l <ill>")
applyglobals_11 = ApplyGlobals(Input=panel_54, AdditionalKeys="ill", AdditionalValues=execute_ssh_18.Stdout)  # -> Output, Pairs
execute_ssh_19 = ExecuteSSH(SSHCommands=applyglobals_11.Output)  # -> Stdout, Stderr, Log, Success
panel_55 = Panel(execute_ssh_19.Stdout)

# ----
# final step: Combine results
panel_56 = Panel("""export PATH=$PATH.:/usr/local/radiance/bin
export RAYPATH=.:/usr/local/radiance/lib
rmtxop <DCannualR> + -s -1 <DCDannualR> + <CDSannualR> > <target>;echo <target>""")
panel_57 = Panel("""DCannualR
DCDannualR
CDSannualR
target""")
and_4 = GateAnd()
analysisperiod = LBAnalysisPeriod(start_month=1, start_day=1, start_hour="8", end_hour="18")  # -> period, hoys, dates; plug-in component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
panel_58 = Panel("C:\Users\mm1013\simulation\DDS_Total.ill")
points_3 = Text(points)
Z = UnitZ(Factor=1)
pt = Point(flatten(sdivide.Points))
long_2 = LongestList(ListA=pt, ListB=Z, PaddingMode=2)  # -> ListA, ListB
readannualresultsi = Honeybee_ReadAnnualResultI(
    illFilesAddress=panel_58,
    testPoints=simplify(long_2.ListA),
    ptsVectors=long_2.ListB,
    DLAIllumThresholds=300,
    runIt=False)  # -> DLA, UDLI_Less_100, UDLI_100_2000, UDLI_More_2000, CDA, sDA, annualProfiles, htmReport; plug-in component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
honeybee = Honeybee_Honeybee()  # -> Vviiiiiiiiiizzz; plug-in component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
reload_analysisgrid = GhPythonScript(pts_file="C:\Users\mm1013\simulation\points.pts", ill_file=panel_58, run=Toggle(True))  # -> out, analysisGrid; inputs hoys: list
# ---------- reload_analysisgrid: Python ----------
"""
    Args:
        _pts_file: Path to a points (*.pts) file
        _ill_file: Path to an illuminance (*.ill) file
        _hoys: A list of hours of the year. This should be the same list as the
            one used to run the simulation earlier.
            
            If you ran an Annual Simulation (using the Annual Daylight, Annual
            Radiation, DC-Grid Based, 3P or 5P recipe), you should provide a
            list of integers from 0 to 8759. If you used smaller timesteps in
            your simulation (e.g. using 'hoys_' input in HoneybeePlus_SkyMatrix
            component), make sure you provide a list with appropriate matching
            timesteps.
            
            If you ran a Solar Access simulation, you could use the hoys output
            from LadybugPlus_SunPath component i.e. the same you provided for the
            Solar Access Recipe.
            
            If you ran a simulation using HoneybeePlus Grid Based Recipe, you
            should enter the same hoy as was used to create the sky.
            
            You can get this _hoys list from:
            (1) LadybugPlus_SunPath component
            (2) LadybugPlus_Analysis Period component
            (3) LadybugPlus_Calculate HOY component
            (4) Standard grasshopper components
        _gridMode_: 0 > load the values. (Default)
            1 > load values as binary. Any non-zero value will be 1. Useful for studies such as Solar Access a.k.a. Sunlight Hours.
            2 > load the values divided by mode number. Use this mode for daylight factor or radiation analysis
        _run: Set to True to load the AnalysisGrid
    Returns:
        analysisGrid: Outputs a analysis grid loaded with results. Connect this
             grid to standard honeybee[+] copmonents to get the values
"""

import rhinoscriptsyntax as rs
from honeybee_radiance.sensorgrid import SensorGrid
#from honeybee.radiance.analysisgrid import AnalysisGrid

if _run == True:


    if _gridMode_ == None:
        gmode = 0
    else:
        gmode = int(_gridMode_)

# first let's create an analysis grid from pts file
    analysisGrid = SensorGrid.from_file(_pts_file)
    

# now let's load the results
    #analysisGrid.set_values_from_file(_ill_file, hoys=_hoys, mode=gmode)
# ---------- end reload_analysisgrid ----------
readannualresultsii = Honeybee_ReadAnnualResultII(resultFilesAddress=panel_58, testPts=long_2.ListA, timeStep=1)  # -> readMe, lessThanRange, inTheRange, moreThanRange; plug-in component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
python = GhPythonScript(x=reload_analysisgrid.analysisGrid)  # -> out, a
# ---------- python: Python ----------
__author__ = "mm1013"
__version__ = "2022.04.06"

import rhinoscriptsyntax as rs

x.info_dict
# ---------- end python ----------
gradient = Gradient(
    LowerLimit="12",
    UpperLimit="10",
    Parameter=readannualresultsii.inTheRange,
    stops=[0: RGB(234, 38, 0), 0.25: RGB(234, 126, 0), 0.5: RGB(254, 244, 84), 0.75: RGB(173, 203, 249), 1: RGB(75, 107, 169)])
bnd = Bounds(Numbers=readannualresultsii.inTheRange)
pt_2 = Point(pt)
falsestart_8 = LBFalseStartToggle(False)
applyglobals_12 = ApplyGlobals(Input="[ -f <file> ] && echo \"1\" || echo \"0\"", AdditionalKeys="file", AdditionalValues="~/simulation/points.pts2")  # -> Output, Pairs
preview = CustomPreview(Geometry=pt_2, Material=gradient)
execute_ssh_20 = ExecuteSSH(SSHCommands=applyglobals_12.Output, Run=falsestart_8)  # -> Stdout, Stderr, Log, Success
panel_59 = Panel(execute_ssh_20.Stdout)

# ----
# Setup globals
# And test them
panel_60 = Panel("proj")
globals = SetupGlobals(Keys=panel_60, Values="~/simulation/myproject")
panel_61 = Panel(globals)
panel_62 = Panel("""<TESTDIR> <TestDir> <AnotherDir>
<ProjName>""")

applyglobals_13 = ApplyGlobals(Input=panel_62)  # -> Output, Pairs

panel_63 = Panel(applyglobals_13.Output)

# ----
# Sun
# sun primitive
panel_64 = Panel("""export PATH=$PATH.:/usr/local/radiance/bin
export RAYPATH=.:/usr/local/radiance/lib
echo "void light solar 0 0 3 1e6 1e6 1e6" > <target>
echo "<target>"
""")

applyglobals_14 = ApplyGlobals(Input=panel_64, AdditionalKeys="target", AdditionalValues="~/simulation/suns.rad")  # -> Output, Pairs
panel_65 = Panel("""export PATH=$PATH.:/usr/local/radiance/bin
export RAYPATH=.:/usr/local/radiance/lib
cnt 5165 | rcalc -e MF:6 -f reinsrc.cal -e Rbin=recno -o 'solar source sun 0 0 4 ${Dx} ${Dy} ${Dz} 0.553' >> <target>
echo <target>""")

execute_ssh_21 = ExecuteSSH(SSHCommands=applyglobals_14.Output, Run=falsestart_6)  # -> Stdout, Stderr, Log, Success

# ----
# solar discs and modifiers for 5165 suns (=MF:6)
panel_66 = Panel("target")
applyglobals_15 = ApplyGlobals(Input=panel_65, AdditionalKeys=panel_66, AdditionalValues=execute_ssh_21.Stdout)  # -> Output, Pairs
execute_ssh_22 = ExecuteSSH(SSHCommands=applyglobals_15.Output)  # -> Stdout, Stderr, Log, Success

# ----
# create black octreeDDS
suns_material = Text(execute_ssh_21.Stdout)
black_rad_files_3 = Text(black_rad_files)
window_mat_3 = Text(window_mat)
window_rad_3 = Text(window_rad)
black_mat_3 = Text(black_mat)
mf6_suns = Text(execute_ssh_22.Stdout)
entwine_7 = Entwine(
    Branch00=window_mat_3,
    Branch01=window_rad_3,
    Branch02=black_mat_3,
    Branch03=black_rad_files_3,
    Branch04=suns_material,
    Branch05=mf6_suns,
    FlattenInputs=True)  # -> flatten(Result)
join_2 = TextJoin(Text=flatten(entwine_7), Join=" ")
panel_67 = Panel("""rads
target""")
applyglobals_16 = ApplyGlobals(
    Input="oconv -f <rads> > <target>;echo <target>",
    AdditionalKeys=panel_67,
    AdditionalValues=[join_2, "~/simulation/myscene_black_sunCoeffecientsDDS.oct"])  # -> Output, Pairs
execute_ssh_23 = ExecuteSSH(SSHCommands=applyglobals_16.Output)  # -> Stdout, Stderr, Log, Success
panel_68 = Panel(execute_ssh_23.Stdout)
octree_blackdds = Text(panel_68)

# ----
# Calculate illuminance sun coefficients for illuminance calculations
panel_69 = Panel("/home/mss/simulation/cdsDDS_illum.mtx")
# Raytracing suns (rcontrib)
panel_70 = Panel("""export PATH=$PATH.:/usr/local/radiance/bin
export RAYPATH=.:/usr/local/radiance/lib
rcontrib -I+ -ab 1 -y 100 -n 8 -ad 256 -lw 1.0e-3 -dc 1 -dt 0 -dj 0 -faf -e MF:6 -f reinhart.cal -b rbin -bn Nrbins -m solar <octree> < <points> > <target>
echo <target>""")
octree_blackdds_2 = Text(octree_blackdds)
points_4 = Text(points)
panel_71 = Panel("""points
octree
target""")
entwine_8 = Entwine(Branch00=points_4, Branch01=octree_blackdds_2, Branch02=panel_69, FlattenInputs=True)  # -> flatten(Result)
applyglobals_17 = ApplyGlobals(Input=panel_70, AdditionalKeys=panel_71, AdditionalValues=entwine_8)  # -> Output, Pairs
and_5 = GateAnd(PointsOk=points2pts.Run)
panel_72 = Panel(applyglobals_17.Output)
execute_ssh_24 = ExecuteSSH(SSHCommands=applyglobals_17.Output, Run=and_5)  # -> Stdout, Stderr, Log, Success
panel_73 = Panel(execute_ssh_24.Stdout)

# ----
# + Results of direct sun coefficients (5165 sample sky)
panel_74 = Panel("/home/mss/simulation/annualR_CDS.ill")
panel_75 = Panel("""export PATH=$PATH.:/usr/local/radiance/bin
export RAYPATH=.:/usr/local/radiance/lib
dctimestep <dcillum> <skymtx> | rmtxop -fa -t -c 47.4 119.9 11.6 - > <target>;echo <target>""")
panel_76 = Panel("""dcillum
skymtx
target""")
entwine_9 = Entwine(Branch00=panel_73, Branch01=m6_sky_mtx, Branch02=panel_74, FlattenInputs=True)  # -> flatten(Result)
and_6 = GateAnd()
applyglobals_18 = ApplyGlobals(Input=panel_75, AdditionalKeys=panel_76, AdditionalValues=entwine_9)  # -> Output, Pairs
execute_ssh_25 = ExecuteSSH(SSHCommands=applyglobals_18.Output, Run=and_6)  # -> Stdout, Stderr, Log, Success
panel_77 = Panel(applyglobals_18.Output)
panel_78 = Panel(execute_ssh_25.Stdout)

panel_79 = Panel("head <ill> -n 13;echo \" \";echo \"Number of lines\";wc -l <ill>")
applyglobals_19 = ApplyGlobals(Input=panel_79, AdditionalKeys="ill", AdditionalValues=execute_ssh_25.Stdout)  # -> Output, Pairs
execute_ssh_26 = ExecuteSSH(SSHCommands=applyglobals_19.Output)  # -> Stdout, Stderr, Log, Success
panel_80 = Panel(execute_ssh_26.Stdout)

# ----
# create octree
window_mat_4 = Text(window_mat)
opaque_mat_2 = Text(opaque_mat)
opaque_rad_2 = Text(opaque_rad)
window_rad_4 = Text(window_rad)
# Octrees
panel_81 = Panel("oconv -f <rads> > ~/simulation/myscene.oct;echo ~/simulation/myscene.oct")

entwine_10 = Entwine(Branch00=window_mat_4, Branch01=window_rad_4, Branch02=opaque_mat_2, Branch03=opaque_rad_2, FlattenInputs=True)  # -> flatten(Result)

join_3 = TextJoin(Text=flatten(entwine_10), Join=" ")
rep_7 = ReplaceText(Text=panel_81, Find="<rads>", Replace=join_3, RecursiveReplace=False)

execute_ssh_27 = ExecuteSSH(SSHCommands=rep_7, Run=and)  # -> Stdout, Stderr, Log, Ran

panel_82 = Panel(execute_ssh_27.Stdout)
octree = Text(execute_ssh_27.Stdout)

# ----
# Generate daylight coefficients
panel_83 = Panel("/home/mss/simulation/dc_illum.mtx")
# Raytracing (rfluxmtx)
panel_84 = Panel("""export PATH=$PATH.:/usr/local/radiance/bin
export RAYPATH=.:/usr/local/radiance/lib
rfluxmtx -I+ -y 100 -lw 0.0001 -ab 5 -ad 5000 -n 8 - <skyglow> -i <octree> < <points> > <target>;echo <target>""")
and_7 = GateAnd(PointsOk=points2pts.Run)
skyglow_3 = Text(skyglow)
octree_2 = Text(octree)
points_5 = Text(points)
panel_85 = Panel("""points
octree
skyglow
target""")
entwine_11 = Entwine(Branch00=points_5, Branch01=octree_2, Branch02=skyglow_3, Branch03=panel_83, FlattenInputs=True)  # -> flatten(Result)
applyglobals_20 = ApplyGlobals(Input=panel_84, AdditionalKeys=panel_85, AdditionalValues=entwine_11)  # -> Output, Pairs
execute_ssh_28 = ExecuteSSH(SSHCommands=applyglobals_20.Output, Run=and_7)  # -> Stdout, Stderr, Log, Success
panel_86 = Panel(applyglobals_20.Output)
panel_87 = Panel(execute_ssh_28.Stdout)

# ----
# Results of daylight coefficients
panel_88 = Panel("/home/mss/simulation/annualR_DC.ill")
# Getting results (dctimestep)
panel_89 = Panel("""export PATH=$PATH.:/usr/local/radiance/bin
export RAYPATH=.:/usr/local/radiance/lib
dctimestep <dcillum> <skymtx> | rmtxop -fa -t -c 47.4 119.9 11.6 - > <target>;echo <target>""")
panel_90 = Panel("""dcillum
skymtx
target""")
entwine_12 = Entwine(Branch00=panel_87, Branch01=execute_ssh_14.Stdout, Branch02=panel_88, FlattenInputs=True)  # -> flatten(Result)
and_8 = GateAnd()
applyglobals_21 = ApplyGlobals(Input=panel_89, AdditionalKeys=panel_90, AdditionalValues=entwine_12)  # -> Output, Pairs
execute_ssh_29 = ExecuteSSH(SSHCommands=applyglobals_21.Output, Run=and_8)  # -> Stdout, Stderr, Log, Success
panel_91 = Panel(execute_ssh_29.Stdout)

panel_92 = Panel("head <ill> -n 13;echo \" \";echo \"Number of lines\";wc -l <ill>")
applyglobals_22 = ApplyGlobals(Input=panel_92, AdditionalKeys="ill", AdditionalValues=execute_ssh_29.Stdout)  # -> Output, Pairs
execute_ssh_30 = ExecuteSSH(SSHCommands=applyglobals_22.Output)  # -> Stdout, Stderr, Log, Success
panel_93 = Panel(execute_ssh_30.Stdout)

entwine_13 = Entwine(
    Branch00=execute_ssh_29.Stdout,
    Branch01=execute_ssh_18.Stdout,
    Branch02=execute_ssh_25.Stdout,
    Branch03="/home/mss/simulation/DDS_Total.ill",
    FlattenInputs=True)  # -> flatten(Result)
applyglobals_23 = ApplyGlobals(Input=panel_56, AdditionalKeys=panel_57, AdditionalValues=entwine_13)  # -> Output, Pairs
execute_ssh_31 = ExecuteSSH(SSHCommands=applyglobals_23.Output, Run=and_4)  # -> Stdout, Stderr, Log, Success
panel_94 = Panel(execute_ssh_31.Stdout)
reload_analysisgrid_2 = GhPythonScript(pts_file=points_3, ill_file=execute_ssh_31.Stdout, hoys=analysisperiod.hoys, run=execute_ssh_31.Success)  # -> out, analysisGrid; inputs hoys: list
# ---------- reload_analysisgrid_2: Python ----------
"""
    Args:
        _pts_file: Path to a points (*.pts) file
        _ill_file: Path to an illuminance (*.ill) file
        _hoys: A list of hours of the year. This should be the same list as the
            one used to run the simulation earlier.
            
            If you ran an Annual Simulation (using the Annual Daylight, Annual
            Radiation, DC-Grid Based, 3P or 5P recipe), you should provide a
            list of integers from 0 to 8759. If you used smaller timesteps in
            your simulation (e.g. using 'hoys_' input in HoneybeePlus_SkyMatrix
            component), make sure you provide a list with appropriate matching
            timesteps.
            
            If you ran a Solar Access simulation, you could use the hoys output
            from LadybugPlus_SunPath component i.e. the same you provided for the
            Solar Access Recipe.
            
            If you ran a simulation using HoneybeePlus Grid Based Recipe, you
            should enter the same hoy as was used to create the sky.
            
            You can get this _hoys list from:
            (1) LadybugPlus_SunPath component
            (2) LadybugPlus_Analysis Period component
            (3) LadybugPlus_Calculate HOY component
            (4) Standard grasshopper components
        _gridMode_: 0 > load the values. (Default)
            1 > load values as binary. Any non-zero value will be 1. Useful for studies such as Solar Access a.k.a. Sunlight Hours.
            2 > load the values divided by mode number. Use this mode for daylight factor or radiation analysis
        _run: Set to True to load the AnalysisGrid
    Returns:
        analysisGrid: Outputs a analysis grid loaded with results. Connect this
             grid to standard honeybee[+] copmonents to get the values
"""

import rhinoscriptsyntax as rs
from honeybee_plus.radiance.analysisgrid import AnalysisGrid

if _run == True:


    if _gridMode_ == None:
        gmode = 0
    else:
        gmode = int(_gridMode_)

# first let's create an analysis grid from pts file
    analysisGrid = AnalysisGrid.from_file(_pts_file)

# now let's load the results
    analysisGrid.set_values_from_file(_ill_file, hoys=_hoys, mode=gmode)
# ---------- end reload_analysisgrid_2 ----------
annualmetrics = HBAnnualDaylightMetrics(results=execute_ssh_31.Stdout)  # -> report, DA, cDA, UDI, UDI_low, UDI_up; plug-in component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
